# Grasshopper definition assignment_1_example5_curve.gh (Grasshopper 1.0.7)
# plug-ins: Hops

cir = Circle(Plane=PlaneXY(0, 0, 0), Radius=Slider(7.2, range=0..10))
divide = DivideCurve(Curve=cir, Count=Slider(16, range=0..100), Kinks=False)  # -> Points, Tangents, Parameters
dispatch = Dispatch(List=divide.Points, DispatchPattern=[True, False])  # -> ListA, ListB
Z = UnitZ(Factor=Slider(3.3, range=0..10))
pt = Point(dispatch.ListA)
pt_2 = Point(dispatch.ListB)
move = Move(Geometry=pt, Motion=Z)  # -> Geometry, Transform
weave = Weave(Pattern=[0, 1], Stream0=move.Geometry, Stream1=pt_2, NullGaps=False)
intcrv = Interpolate(Vertices=weave, Degree=3, Periodic=True, KnotStyle=1)  # -> Curve, Length, Domain
concat = Concatenate(FragmentA="http://127.0.0.1:5000", FragmentB="/pointat")
hops = Hops(
    _Path=concat,
    Curve=intcrv.Curve,
    T=Slider(53, range=0..70),
    CacheResultsInMemory=True,
    CacheSolveResults=True,
    RemoteDefinitionLocation="http://127.0.0.1:5000/pointat",
    RemoteSolveVersion=(0, 1, 0),
    ShowInput_Enabled=False,
    ShowInput_Path=True,
    SynchronousSolve=True)
