# Grasshopper definition assignment_1_example6_circular_graph.gh (Grasshopper 1.0.7)
# plug-ins: Hops

number_slider = Slider(5, range=0..10)
concat = Concatenate(FragmentA="http://127.0.0.1:5000", FragmentB="/createCircularGraph")
hops = Hops(
    _Path=concat,
    CountX=number_slider,
    CountY=number_slider,
    CacheResultsInMemory=True,
    CacheSolveResults=True,
    RemoteDefinitionLocation="http://127.0.0.1:5000/createCircularGraph",
    RemoteSolveVersion=(0, 1, 0),
    ShowInput_Enabled=False,
    ShowInput_Path=True,
    SynchronousSolve=True)  # -> Nodes, Edges
panel = Panel(hops.Nodes)
panel_2 = Panel(hops.Edges)
